# Grasshopper definition HelloAntiloop.gh (Grasshopper 0.9.76)
# plug-ins: antiloop

toggle = BooleanToggle(True)
do = DoAntiloop(Number=Slider(0, range=0..10))  # -> Number, Loop
addition = Addition(A=do.Number, B=Slider(1, range=0..1))
smaller = SmallerThan(FirstNumber=addition, SecondNumber=Slider(150, range=0..1000))  # -> SmallerThan, OrEqualTo
panel = Panel(do.Number)
panel_2 = Panel(smaller.SmallerThan)
while = AntiloopWhile(Condition=smaller.SmallerThan, Number=addition, Loop=do.Loop)
panel_3 = Panel(while)
